# Dynamo graph DesignScript.dyn (Dynamo 2.18.1.5096)

code_block = CodeBlock { s=10000; a=12255..156987..s; b=1..10; rounda=(Math.Round(a/10, 0))*10; }
code_block_2 = CodeBlock { ["a".."j"]; "a".."j"; }
code_block_3 = CodeBlock { 1..10; }
code_block_4 = CodeBlock { 1..10; }
code_block_5 = CodeBlock(a=code_block_3, b=code_block_4) { a<1>+b<0>; }
watch = Watch()  # unwired: arg0
round = Math.Round()  # unwired: number, digits
code_block_6 = CodeBlock { a<1>+b<0>; }  # unwired: a, b
