# Dynamo graph Location_10.05.dyn (Dynamo 2.18.1.5096)
# packages: bimorphNodes 5.1.3

categories = Categories("OST_Furniture")
all_elements_of_category = ElementsOfCategory(Category=categories)
code_block = CodeBlock { "CCI_Location_ID"; }
room = FamilyInstance.Room(familyInstance=all_elements_of_category)
number = Room.Number(room=room)
setParameterByName = Element.SetParameterByName(element=all_elements_of_category, parameterName=code_block, value=number)
code_block_2 = CodeBlock { ["Furniture","Casework","Plumbing Fixtures","Air Terminals","Mechanical Equipment"]; }
byName = Category.ByName(name=code_block_2)
categories_2 = Categories("OST_GenericModel")
all_elements_of_category_2 = ElementsOfCategory(Category=categories_2)
intersectsElement = Revit.Element.IntersectsElement(elementSetA=all_elements_of_category_2, elementSetB=all_elements_of_category)
element = Results.ElementIntersectionResult.Element(elementIntersectionResult=intersectsElement)
name = Element.Name(element=all_elements_of_category_2)
