# Dynamo graph Location_envelopes_10.06.dyn (Dynamo 2.18.1.5096)
# packages: bimorphNodes 4.0.3

# note: Input list of elements to clash. Note that BimorphNodes LinkElement's can also be input.
# note: Use the ElementIntersectionResult query nodes to interrogate the results.

# group: NODE DETAILS
# note: AUTHOR + COPYRIGHT
# Copyright 2021 Bimorph Consultancy LTD
# Thomas Mahon
# note: CONTACT
# www.bimorph.com
# info@bimorph.com
# @bimorphBIM
# note: PACKAGE NAME
# bimorphNodes
# note: FOLLOW US
# Follow us to get the latest digital engineering news & be the first to hear about bimorphNodes updates:
# FACEBOOK:  facebook.com/bimorphBIM
# LINKEDIN:  linkedin.com/company/bimorph-bim
# TWITTER:  @bimorphBIM

# group: Alt andet end denne grønne farve kan ignoreres
# note: problematikker:
# bygningsdele beholder navn fra forrige intersect, indtil de bliver overskrevet. Derfor vil et objekt der intersecter to forskellige, bare beholde den seneste værdi af de to. Og de objekter der liggerudenfor alle, beholder bare den seneste de modtog.
# 2: intersect er nok, behøves ikke at være 100% indenfor

categories = Categories("OST_Walls")
all_elements_of_category_walls = ElementsOfCategory(Category=categories)
name = FamilyType.Name(familyType=all_elements_of_category_walls)
wall_types = WallTypes("Wall 2")
name_2 = FamilyType.Name(familyType=wall_types)
code_block = CodeBlock(TypeName=name, Name=name_2) { TypeName==Name; }
filterByBoolMask = List.FilterByBoolMask(list=all_elements_of_category_walls, mask=code_block)
watch = Watch(filterByBoolMask.in)
categories_2 = Categories("OST_NurseCallDevices")
all_elements_of_category_nurse = ElementsOfCategory(Category=categories_2)  # "All Elements of Category Nurse Call"
intersectsElement = Revit.Element.IntersectsElement(elementSetA=watch, elementSetB=all_elements_of_category_nurse)
element = Results.ElementIntersectionResult.Element(elementIntersectionResult=intersectsElement)
code_block_2 = CodeBlock { "CCI_Location_ID"; }
intersectingElements = Results.ElementIntersectionResult.IntersectingElements(elementIntersectionResult=intersectsElement)
name_3 = Element.Name(element=intersectingElements)
setParameterByName = Element.SetParameterByName(element=element, parameterName=code_block_2, value=name_3)
isSupported = Results.ElementIntersectionResult.IsSupported(elementIntersectionResult=intersectsElement)
code_block_3 = CodeBlock { "Wall 2"; }
