# Dynamo graph Rename_Grids_A-Z.dyn (Dynamo 2.19.3.6394)

select_all_grid_lines_every_time = DSModelElementsSelection()  # 15 picked in the model
code_block = CodeBlock { "Name"; Y=["A".."Z"]; Z=Y+Y; X=Flatten(Z,1); }
setParameterByName = Element.SetParameterByName(element=select_all_grid_lines_every_time, parameterName=code_block.out0, value=code_block.X)  # frozen
curve = Grid.Curve(grid=setParameterByName)
startPoint = Curve.StartPoint(curve=curve)
select_first_grid_line = DSModelElementSelection()  # 1 picked in the model
curve_2 = Grid.Curve(grid=select_first_grid_line)
startPoint_2 = Curve.StartPoint(curve=curve_2)
distanceTo = Geometry.DistanceTo(geometry=startPoint, other=startPoint_2)
sortIndexByValue = List.SortIndexByValue(list=distanceTo)
getItemAtIndex = List.GetItemAtIndex(list=setParameterByName, index=sortIndexByValue)
code_block_2 = CodeBlock { "Name"; L=["A".."Z"]; List.Flatten(L,1); }
setParameterByName_2 = Element.SetParameterByName(element=getItemAtIndex, parameterName=code_block_2.out0, value=code_block_2.out2)  # frozen
code_block_3 = CodeBlock(Element=select_all_grid_lines_every_time) { N="Name"; Y=[1..99]; X=Flatten(Y,1); Z=StringFromObject(X); N; Element.SetParameterByName("Name",Y); }
watch = Watch(code_block_3.out5)
code_block_4 = CodeBlock { "name"; }
code_block_5 = CodeBlock { 1..66; }
string_from_object = FromObject(object=code_block_5)
setParameterByName_3 = Element.SetParameterByName(element=select_all_grid_lines_every_time, parameterName=code_block_4, value=string_from_object)
