# Dynamo graph find højeste værdi.dyn (Dynamo 2.18.1.5096)

code_block = CodeBlock { [[2,6,9,18,5],[2,6,9,1,5],[2,6,9,1,5],[6.1,6,6,1,5],[2,6,9,11,5]]; }
sortIndexByValue = List.SortIndexByValue(list=code_block@L2)
getItemAtIndex = List.GetItemAtIndex(list=code_block@L2, index=sortIndexByValue@L2)
lastItem = List.LastItem(list=getItemAtIndex@L2)
