# Dynamo graph geometri i Dynamo.dyn (Dynamo 2.18.1.5096)

Y = Vector.Y()  # unwired: vector
code_block = CodeBlock { [0..720..#21]; [0..0..#21]; }
sin = Math.Sin(angle=code_block.out0)
code_block_2 = CodeBlock(x=code_block.out0, y=sin) { Point.ByCoordinates(x,y*60,0); }
byControlPoints = NurbsCurve.ByControlPoints(points=code_block_2)
code_block_3 = CodeBlock { 80; }
extrude = Curve.Extrude(curve=byControlPoints, distance=code_block_3)
thicken = Surface.Thicken(surface=extrude, thickness=code_block_3)
