# Dynamo graph grader mod vinden.dyn (Dynamo 2.18.1.5096)

select_model_element = DSModelElementSelection()  # 1 picked in the model
code_block = CodeBlock { "v_v"; 15; }
setParameterByName = Element.SetParameterByName(element=select_model_element, parameterName=code_block.out0, value=code_block.out1)
