# Dynamo graph growing.dyn (Dynamo 2.19.3.6394)

file_path = Filename("..\..\..\..\..\..\..\DATA\DYN\growing.csv")  # frozen
exportCSV = Data.ExportCSV(filePath=file_path)  # unwired: data
string_from_object = FromObject()  # unwired: object
list_create = List.Create()  # unwired: item0, item1, item2, item3, item4, item5, item6, item7
file_path_2 = Filename(".\growing.txt")  # frozen
code_block = CodeBlock { "x"; }
writeText = FileSystem.WriteText(filePath=file_path_2, text=code_block)
appendText = FileSystem.AppendText()  # unwired: filePath, text
importCSV = Data.ImportCSV(filePath=file_path)
code_block_2 = CodeBlock { 3; }
flatten = List.Flatten(list=importCSV, amount=code_block_2)
now = DateTime.Now()
components = DateTime.Components(dateTime=now)
code_block_3 = CodeBlock(q=components.year, w=components.month, e=components.day, r=components.hour, t=components.minute, y=components.second, u=components.millisecond) { [q,w,e,r,t,y,u]; }
code_block_4 = CodeBlock(x=flatten, y=code_block_3) { x; y; [x+y]; [x,y]; }
watch = Watch(code_block_4.out3)
flatten_2 = List.Flatten(list=watch)
watch_2 = Watch(flatten_2)
code_block_5 = CodeBlock(x=code_block_3) { 0; 100; 100/x; }
random = Math.Random(value1=code_block_5.out0, value2=code_block_5.out1, seed=code_block_5.out2)
code_block_6 = CodeBlock { 0; 100; }
random_2 = Math.Random(value1=code_block_6.out0, value2=code_block_6.out1, seed=code_block_3)
code_block_7 = CodeBlock(x=random, y=random_2) { Point.ByCoordinates(x,y); }
byStartPointEndPoint = Line.ByStartPointEndPoint(startPoint=code_block_7)  # unwired: endPoint
X = Vector.X()  # unwired: vector
ZAxis = Vector.ZAxis()
code_block_8 = CodeBlock { 0; 360; }
random_3 = Math.Random(value1=code_block_8.out0, value2=code_block_8.out1, seed=code_block_3)
rotate = Vector.Rotate(vector=X, axis=ZAxis, degrees=random_3)
byTwoPoints = Vector.ByTwoPoints()  # unwired: start, end
