# Dynamo graph hent længste edge fra Model-in-place_02.dyn (Dynamo 2.19.3.6394)

select_model_element = DSModelElementSelection()  # 1 picked in the model
code_block = CodeBlock { [[2,6,9,18,5],[2,6,9,1,5],[2,6,9,1,5],[6.1,6,6,1,5],[2,6,9,11,5]]; }
code_block_2 = CodeBlock { "Comments"; "5"; }
categories = Categories("OST_Walls")
all_elements_of_category = ElementsOfCategory(Category=categories)
solids = Element.Solids(element=all_elements_of_category)
code_block_3 = CodeBlock(L=solids) { List.Flatten(L,1); }
edges = Topology.Edges(topology=code_block_3)
curveGeometry = Edge.CurveGeometry(edge=edges)
XY = Plane.XY()
pullOntoPlane = Curve.PullOntoPlane(curve=curveGeometry, plane=XY)
length = Curve.Length(curve=pullOntoPlane)
code_block_4 = CodeBlock(list=length) { mask=DSCore.Object.IsNull(list); List.FilterByBoolMask(list,mask); }
code_block_5 = CodeBlock(L=code_block_4.out1) { Dictionary.ValueAtKey(L,"out"); }

# group: Find højeste værdi
code_block_6 = CodeBlock(x=code_block_5) { x; x; }
sortIndexByValue = List.SortIndexByValue(list=code_block_6.out1@L2)
getItemAtIndex = List.GetItemAtIndex(list=code_block_6.out0@L2, index=sortIndexByValue@L2)
lastItem = List.LastItem(list=getItemAtIndex@L2)

code_block_7 = CodeBlock(t=lastItem, RevitElement=all_elements_of_category) { V=Math.Round(t,0); S=String.FromObject(V); RevitElement.SetParameterByName("Comments",S); }
watch = Watch(code_block_7.out2)
