# Dynamo graph int_Walls_higher.dyn (Dynamo 2.19.3.6394)

categories = Categories("OST_Walls")
all_elements_of_category = ElementsOfCategory(Category=categories)
elementType = Element.ElementType(element=all_elements_of_category)
name = ElementType.Name(elementType=elementType)
wall_types = WallTypes("Interior - Generic - 120mm")
name_2 = ElementType.Name(elementType=wall_types)
code_block = CodeBlock(x=name, y=name_2) { x==y; }
filterByBoolMask = List.FilterByBoolMask(list=all_elements_of_category, mask=code_block)
code_block_2 = CodeBlock { "Unconnected Height"; }
getParameterValueByName = Element.GetParameterValueByName(element=filterByBoolMask.in, parameterName=code_block_2)
code_block_3 = CodeBlock { 4000; }
code_block_4 = CodeBlock(x=getParameterValueByName, y=code_block_3) { x>y; }
filterByBoolMask_2 = List.FilterByBoolMask(list=filterByBoolMask.in, mask=code_block_4)
