# Dynamo graph pixel_tiles_simple.dyn (Dynamo 2.18.1.5096)

# note: select three points on the plane

# group: load image and create list of pixels
file_path = Filename(".\Bene_64x82.bmp")
file_from_path = FileObject(path=file_path)
readFromFile = Image.ReadFromFile(file=file_from_path)
watch_image = WatchImageCore(image=readFromFile)  # frozen
dimensions = Image.Dimensions(image=readFromFile)
pixels = Image.Pixels(image=readFromFile, xSamples=dimensions.width, ySamples=dimensions.height)

categories = Categories("OST_GenericModel")
all_elements_of_category = ElementsOfCategory(Category=categories)

# group: receive pixels, compute brightness, set parameter in each family.
code_block = CodeBlock { 3; }
flatten = List.Flatten(list=pixels, amount=code_block)
brightness = Color.Brightness(color=flatten)
code_block_2 = CodeBlock(c=brightness) { "c"; c*255; "b"; b; }  # unwired: b
setParameterByName = Element.SetParameterByName(element=all_elements_of_category, parameterName=code_block_2.out0, value=code_block_2.out1)
setParameterByName_2 = Element.SetParameterByName(element=all_elements_of_category, parameterName=code_block_2.out2, value=code_block_2.b)

watch = Watch(flatten)
code_block_3 = CodeBlock { "pixel_nummer"; }  # frozen
getParameterValueByName = Element.GetParameterValueByName(element=all_elements_of_category, parameterName=code_block_3)
sortIndexByValue = List.SortIndexByValue(list=getParameterValueByName)
sortByKey = List.SortByKey()  # frozen; unwired: list, keys
sortByFunction = List.SortByFunction()  # unwired: list, sortFunction
