# Dynamo graph startup revit.dyn (Dynamo 2.19.3.6394)
# packages: startup 1.1.2

# group: Read excel
file_path = Filename(".\ProjectStartup.xlsx")
file_from_path = FileObject(path=file_path)
code_block = CodeBlock { "Levels"; }
importExcel = Data.ImportExcel(file=file_from_path, sheetName=code_block)
firstItem = List.FirstItem(list=importExcel)
restOfItems = List.RestOfItems(list=importExcel)

# group: Read Excel floor plan data
code_block_2 = CodeBlock { "Floor Plans"; }
importExcel_2 = Data.ImportExcel(file=file_from_path, sheetName=code_block_2)
firstItem_2 = List.FirstItem(list=importExcel_2)
restOfItems_2 = List.RestOfItems(list=importExcel_2)
transpose = List.Transpose(lists=restOfItems_2)

# group: Create revit levels
transpose_2 = List.Transpose(lists=restOfItems)
code_block_3 = CodeBlock { 1; 0; }
getItemAtIndex = List.GetItemAtIndex(list=transpose_2, index=code_block_3.out0)
getItemAtIndex_2 = List.GetItemAtIndex(list=transpose_2, index=code_block_3.out1)
byElevationAndName = Level.ByElevationAndName(elevation=getItemAtIndex, name=getItemAtIndex_2)

# group: Create revit floor plan views
code_block_4 = CodeBlock { 1; }
getItemAtIndex_3 = List.GetItemAtIndex(list=transpose, index=code_block_4)
indexOf = List.IndexOf(list=getItemAtIndex_2, element=getItemAtIndex_3@L1)
getItemAtIndex_4 = List.GetItemAtIndex(list=byElevationAndName, index=indexOf)
byLevel = FloorPlanView.ByLevel(level=getItemAtIndex_4)

# group: Floor plan views
code_block_5 = CodeBlock { "Floor Plans"; }
code_block_6 = CodeBlock { 0; }
getItemAtIndex_5 = List.GetItemAtIndex(index=code_block_6)  # unwired: list
setParameterByName = Element.SetParameterByName(element=byLevel, parameterName=code_block_5, value=getItemAtIndex_5)

# group: Create elevation views
categories = Categories("OST_VolumeOfInterest")
all_elements_of_category = ElementsOfCategory(Category=categories)
firstItem_3 = List.FirstItem(list=all_elements_of_category)
element_classes = ElementTypes("ViewFamilyType")
all_elements_of_class = ElementsOfType(element_class=element_classes)
code_block_7 = CodeBlock { 5; }
getItemAtIndex_6 = List.GetItemAtIndex(list=all_elements_of_class, index=code_block_7)
byScopeBox = Custom[Elevations.ByScopeBox](firstItem_3, getItemAtIndex_6)  # frozen; package startup
name = Element.Name(element=all_elements_of_class)

# group: Set elevation view names
code_block_8 = CodeBlock { "View Name"; }
code_block_9 = CodeBlock { ["ELE_01","ELE_02","ELE_03","ELE_04"]; }
setParameterByName_2 = Element.SetParameterByName(element=byScopeBox, parameterName=code_block_8, value=code_block_9)

# group: Read Sheet Data
code_block_10 = CodeBlock { "Sheets"; }
importExcel_3 = Data.ImportExcel(file=file_from_path, sheetName=code_block_10)
firstItem_4 = List.FirstItem(list=importExcel_3)
restOfItems_3 = List.RestOfItems(list=importExcel_3)
transpose_3 = List.Transpose(lists=restOfItems_3)
code_block_11 = CodeBlock { 0; 1; 2; }
getItemAtIndex_7 = List.GetItemAtIndex(list=transpose_3, index=code_block_11.out1)
getItemAtIndex_8 = List.GetItemAtIndex(list=transpose_3, index=code_block_11.out0)
getItemAtIndex_9 = List.GetItemAtIndex(list=transpose_3, index=code_block_11.out2)

# group: Create ceiling plans
code_block_12 = CodeBlock { "Reflected Ceiling Plans"; }
importExcel_4 = Data.ImportExcel(file=file_from_path, sheetName=code_block_12)
firstItem_5 = List.FirstItem(list=importExcel_4)
restOfItems_4 = List.RestOfItems(list=importExcel_4)
transpose_4 = List.Transpose(lists=restOfItems_4)
code_block_13 = CodeBlock { 1; }
getItemAtIndex_10 = List.GetItemAtIndex(list=transpose_4, index=code_block_13)
indexOf_2 = List.IndexOf(list=getItemAtIndex_2, element=getItemAtIndex_10@L1)
getItemAtIndex_11 = List.GetItemAtIndex(list=byElevationAndName, index=indexOf_2)
byLevel_2 = CeilingPlanView.ByLevel(level=getItemAtIndex_11)
code_block_14 = CodeBlock { "View Name"; }
code_block_15 = CodeBlock { 0; }
getItemAtIndex_12 = List.GetItemAtIndex(list=transpose_4, index=code_block_15)
setParameterByName_3 = Element.SetParameterByName(element=byLevel_2, parameterName=code_block_14, value=getItemAtIndex_12)

# group: Set floor plan view names
code_block_16 = CodeBlock { "View Name"; }
code_block_17 = CodeBlock { 0; }
getItemAtIndex_13 = List.GetItemAtIndex(list=transpose, index=code_block_17)
setParameterByName_4 = Element.SetParameterByName(element=byLevel, parameterName=code_block_16, value=getItemAtIndex_13)

list_create = List.Create(item0=setParameterByName_4, item1=setParameterByName_3)
flatten = List.Flatten(list=list_create)

# group: Revit views by name
watch = Watch(flatten)
code_block_18 = CodeBlock { "View Name"; }
getParameterValueByName = Element.GetParameterValueByName(element=watch, parameterName=code_block_18)
indexOf_3 = List.IndexOf(list=getParameterValueByName, element=getItemAtIndex_9@L2)
getItemAtIndex_14 = List.GetItemAtIndex(list=watch, index=indexOf_3)

# group: Place Drafting views on sheet without views create sheets
views = Views("Drafting 1")
isNull = Object.IsNull()  # unwired: object
replaceByCondition = Replace(item=getItemAtIndex_14, replaceWith=views, condition=isNull)

# group: Select Title Block Family Type
code_block_19 = CodeBlock { "E1 30x42 Horizontal"; }
byName = FamilyType.ByName(name=code_block_19)
watch_2 = Watch(byName)
family_types = FamilyTypes("E1 30 x 42 Horizontal:E1 30x42 Horizontal")
watch_3 = Watch(family_types)
byNameNumberTitleBlockAndView = Sheet.ByNameNumberTitleBlockAndView(sheetName=getItemAtIndex_7, sheetNumber=getItemAtIndex_8, titleBlockFamilyType=byName, view=replaceByCondition)

viewports = Custom[Sheet.Viewports](byNameNumberTitleBlockAndView)  # package startup
flatten_2 = List.Flatten(list=viewports)
moveByVector = Element.MoveByVector(element=flatten_2)  # unwired: vector
byCoordinates = Vector.ByCoordinates()
