# Dynamo graph truchet_tiling_ROTATION.dyn (Dynamo 2.18.1.5096)

code_block = CodeBlock { "hexa_tile_instance_based"; "truchet_tile"; }
byName = FamilyType.ByName(name=code_block.out1)
byFamilyType = FamilyInstance.ByFamilyType(familyType=byName)
watch = Watch(byFamilyType)
code_block_2 = CodeBlock { [0,60,120,180,240,300]; }
count = List.Count(list=watch)
code_block_3 = CodeBlock(x=count) { x/5; }
cycle = List.Cycle(list=code_block_2, amount=code_block_3)
now = DateTime.Now()
components = DateTime.Components(dateTime=now)
code_block_4 = CodeBlock(q=components.year, w=components.month, e=components.day, r=components.hour, t=components.minute, y=components.second, u=components.millisecond) { q+w+e+r+t+y+u; }
code_block_5 = CodeBlock(x=code_block_4) { x+1; }
shuffle = List.Shuffle(list=cycle, seed=code_block_5)
setRotation = FamilyInstance.SetRotation(familyInstance=watch, degree=shuffle, lacing=Shortest)
random_seed = IntegerSlider(38, range=0..100 step 1)
code_block_6 = CodeBlock(y=random_seed) { x+y; }  # unwired: x
